# Dynamo graph script.dyn (Dynamo 2.3.2.15696)
# packages: Genius Loci 2021.11.10, Data-Shapes 2021.2.94, Orchid 200.4.0.7938, Rhythm 2020.7.25

openView = Orchid.RevitProject.Common.Document.OpenView()  # unwired: view
code_block = CodeBlock { "Comentarios sin Resolver"; }
code_block_2 = CodeBlock { "SELECCIONAR"; "CANCELAR"; 430; 900; }
n3dview_collector = Custom[3DView Collector]()  # package Genius Loci; Retrieves the 3D views in the active or given document.
name = Element.Name(element=n3dview_collector)
code_block_3 = CodeBlock { "_"; }
split = String.Split(str=name, separator0=code_block_3)
code_block_4 = CodeBlock { 0; }
getItemAtIndex = List.GetItemAtIndex(list=split@L2, index=code_block_4)
code_block_5 = CodeBlock { "Comentarios sin Resolver"; }
code_block_6 = CodeBlock { "SELECCIONAR"; "CANCELAR"; 430; }
code_block_7 = CodeBlock { "Workset"; }
all = Orchid.RevitProject.Common.Workset.All()
name_2 = Orchid.RevitProject.Common.Workset.Name(workset=all)
code_block_8 = CodeBlock { 2; }
dropItems = List.DropItems(list=name_2, amount=code_block_8)
code_block_9 = CodeBlock { 0; }
radiobuttons_data = Custom[RadioButtons Data](InputName=code_block_7, Keys=dropItems, Values=dropItems, DefaultValueIndex=code_block_9)  # package Data-Shapes; Create radio buttons input for UI.MultipleInputForm ++ .
boolean = BoolSelector(true)
multipleinputform = Custom[MultipleInputForm ++](Description_optional=code_block_5, ButtonText_optional=code_block_6.out0, Inputs=radiobuttons_data, Toggle=boolean, CancelButtonText_optional=code_block_6.out1, Width_optional=code_block_6.out2)  # package Data-Shapes; Create a form with multiple inputs. see www.data-shapes.net for tutorials and infos!
eq = getItemAtIndex == multipleinputform.User_Inputs  # lacing=Longest
filterByBoolMask = List.FilterByBoolMask(list=n3dview_collector, mask=eq)
code_block_10 = CodeBlock { "Estatus Comentario"; }
getParameterValueByName = Element.GetParameterValueByName(element=filterByBoolMask.in, parameterName=code_block_10)
code_block_11 = CodeBlock { 1; }
eq_2 = getParameterValueByName == code_block_11
filterByBoolMask_2 = List.FilterByBoolMask(list=filterByBoolMask.in, mask=eq_2)
name_3 = Element.Name(element=filterByBoolMask_2.out)
code_block_12 = CodeBlock { "_"; }
split_2 = String.Split(str=name_3, separator0=code_block_12)
firstItem = List.FirstItem(list=split_2@L2)
code_block_13 = CodeBlock(ws=firstItem) { "Comentarios "+ws; }
radiobuttons_data_2 = Custom[RadioButtons Data](Keys=name_3, Values=filterByBoolMask_2.out)
inputgroup_data = Custom[InputGroup Data](GroupTitle=code_block_13, Inputs=radiobuttons_data_2)  # package Data-Shapes; Creates a group of inputs for UI.MultipleInputForm ++ . Check out www.data-shapes.net for more infos !
code_block_14 = CodeBlock { "Estatus"; }
code_block_15 = CodeBlock(x=filterByBoolMask_2.out) { x; }
code_block_16 = CodeBlock { "Estatus Comentario"; }
getParameterValueByName_2 = Element.GetParameterValueByName(element=code_block_15, parameterName=code_block_16)
groupByKey = List.GroupByKey(list=code_block_15, keys=getParameterValueByName_2)
string_from_object = FromObject(obj=groupByKey.unique_keys)
count = List.Count(list=groupByKey.groups@L2)
byArgbUI = ByArgbUINodeModel(SliderValue=255, rValue="37", gValue="255", bValue="43")  # "UI.Color.ByArgbUI"
byArgbUI_2 = ByArgbUINodeModel(SliderValue=255, rValue="255", gValue="15", bValue="31")  # "UI.Color.ByArgbUI"
list_create = List.Create(item0=byArgbUI, item1=byArgbUI_2)
pieChart = Custom[PieChart](Chart_name=code_block_14, series=string_from_object, values=count, Chart_colors_optionnal=list_create)  # package Data-Shapes; PieChart
list_create_2 = List.Create(item0=inputgroup_data, item1=pieChart)
flatten = List.Flatten(list=list_create_2)
code_block_17 = CodeBlock(x=multipleinputform.User_Inputs)
# ---------- code_block_17.designscript (12 lines) ----------
x;
[Imperative]
{
	if(x == null)
	{
		return = [];
	}
	else
	{
		return = true;
	}
};
# ----------------------------------------
multipleinputform_2 = Custom[MultipleInputForm ++](Description_optional=code_block, ButtonText_optional=code_block_2.out0, Inputs=flatten, Toggle=code_block_17.out1, CancelButtonText_optional=code_block_2.out1, MaxHeight_optional=code_block_2.out3, Width_optional=code_block_2.out2)
function_apply = ApplyFunction(func=openView, arg1=multipleinputform_2.User_Inputs)  # frozen
code_block_18 = CodeBlock(x=function_apply)
# ---------- code_block_18.designscript (12 lines) ----------
x;
[Imperative]
{
	if(x == null)
	{
		return = [];
	}
	else
	{
		return = x;
	}
};
# ----------------------------------------
name_4 = Element.Name(element=code_block_18.out1)
code_block_19 = CodeBlock { "Comentario"; }
getParameterValueByName_3 = Element.GetParameterValueByName(element=code_block_18.out1, parameterName=code_block_19)
ʳʰʸᵗʰᵐ_helpers_usermessage = Rhythm.Revit.Helpers.Helpers.UserMessage(caption=name_4, message=getParameterValueByName_3, obj=getParameterValueByName_3)
